# Dynamo graph families_GetCategoryFromFile.dyn (Dynamo 1.3.3.4651)

# group: Parallax Dynamo Template
# note: </Title>
# note: <Title>

# group: Input
# note: For selection and whatnot

# group: Background
# note: For workflow

# group: Control
# note: For sliders and other options

# group: To Revit
# note: For changes made to Revit

# group: Annotation
# note: For notes and titles

# group: Info
# note: For general Information

# group: Other
# note: For general other needs

# group: Read a directory for RFAs
string = StringInput("C:\Users\JohnPierson\Desktop\OfficeDynamoWorkflows\familiesToAudit")
fromPath = DirectoryObject(string)  # "Directory.FromPath"
code_block = CodeBlock { "*.rfa"; }
contents = Directory.Contents(fromPath, code_block)
readText = File.ReadText(contents)

# group: This calculates the position of the category name
string_2 = StringInput("<category>")
lastIndexOf = String.LastIndexOf(readText, string_2)
string_3 = StringInput("</category>")
lastIndexOf_2 = String.LastIndexOf(readText, string_3)
sub = lastIndexOf_2 - lastIndexOf

substring = String.Substring(str=readText, startIndex=lastIndexOf, length=sub)

# group: Get the category name
code_block_2 = CodeBlock { "<term>"; "</term>"; }
split = String.Split(substring, code_block_2.out0, code_block_2.out1)
code_block_3 = CodeBlock { 1; }
getItemAtIndex = List.GetItemAtIndex(list=split@L2, index=code_block_3)

code_block_4 = CodeBlock {  }
code_block_5 = CodeBlock {  }
code_block_6 = CodeBlock {  }
code_block_7 = CodeBlock {  }
